# Grasshopper definition slicer.gh (Grasshopper 1.0.7)

outer = Slider(20, range=20..40)
points = Slider(24, range=10..30)
inner = Slider(8, range=1..10)
python = GhPythonScript(inner_radius=inner, outer_radius=outer, num_points=points)  # -> curve, points
# ---------- python: Python ----------
import math
import random
import rhinoscriptsyntax as rs

points = []
for p in range(int(num_points)):
    theta = p * (2 * math.pi / num_points)
    length = inner_radius + (random.random() * (outer_radius - inner_radius))
    x = length*math.cos(theta)
    y = length*math.sin(theta)
    points.append(rs.AddPoint([x, y, 0]))

points.append(points[0])
# ---------- end python ----------
trigger = Trigger(Interval=-1000, TimerInterval=1000, Target=python_2)
vec = VectorXYZ(XComponent=0, YComponent=0, ZComponent=Slider(2, range=1..10))  # -> Vector, Length
intcrv = Interpolate(Vertices=python.points, Degree=3, Periodic=False, KnotStyle=1)  # -> Curve, Length, Domain
crv = Curve(<curve referenced from the Rhino model>)
extr = Extrude(Base=crv, Direction=vec.Vector)
python_2 = GhPythonScript()  # -> out, file
# ---------- python_2: Python ----------
import rhinoscriptsyntax as rs

filter = "GCode (*.gcode)|*.gcode|All Files (*.*)|*.*||"
file = rs.SaveFileName("", filter)
# ---------- end python_2 ----------
geo = Geometry(<brep referenced from the Rhino model>)
cap = CapHoles(Brep=extr)
dam = DataDam(DataA=python_2.file, BufferDelay=10000000, BufferMode=0)
python_3 = GhPythonScript(filename=dam, shape=geo)  # -> out, lines, turtle, blah, starts, ends; inputs shape: Brep
# ---------- python_3: Python ----------
# code required so that library reloads appropriately
# must be above other import statements
import sys
import math
import time
import operator as op
to_delete = list()
for module in sys.modules:
    if "slicing_utils" in module:
      to_delete.append(module)
    if "extruder_turtle" in module:
      to_delete.append(module)
    if "turtle_utilities" in module:
      to_delete.append(module)
for module in to_delete:
    sys.modules.pop(module)

import slicing_utils
from slicing_utils import *

import extruder_turtle
from extruder_turtle import *

import turtle_utilities as tu

import Rhino
import rhinoscriptsyntax as rs

reload(slicing_utils)
reload(extruder_turtle)


# Main code
# set up the turtle
t = ExtruderTurtle()
t.setup(filename=filename, printer = "eazao")
t.set_extrude_width(0.84)
print("standard layer height is: " +str(t.get_layer_height()))
print("standard extrusion width is: "+str(t.get_extrude_width()))

# draw
#h = 10
#fill_layer_with_fermat_spiral(t, shape, h*t.get_layer_height())

slice_fermat_fill(t, shape)
#slice_spiral_fill(t, shape)
#slice_contour_fill(t, shape)

# visualize the turtle's path
#turtle = t.draw_turtle()
lines = t.get_lines()

# close the generated .gcode file
t.finish()
# ---------- end python_3 ----------
panel = Panel(python_3.out)
pt = Point(python_3.starts)
pt_2 = Point(python_3.ends)
